# Grasshopper definition crb15000_robot_control.ghx (Grasshopper 1.0.7)

number_slider = Slider(50, range=0..960)
number_slider_2 = Slider(0.25, range=0..1)
pt = Point(Point(0.495, 0, 0.019))
xy = XYPlane(Origin=pt)
cir = Circle(Plane=xy, Radius=number_slider_2)
divide = DivideCurve(Curve=cir, Count=number_slider, Kinks=False)  # -> Points, Tangents, Parameters
faktor = Slider(160.6, range=1..750)
panel = Panel(divide.Points)
series = Series(Start="0", Step=1, Count=number_slider)
multiplication = Multiplication(A=series, B=faktor)
panel_2 = Panel(series)
mod = Modulus(A=multiplication, B=number_slider)
panel_3 = Panel(mod)
item = ListItem(List=panel, Index=panel_2, Wrap=True)
item_2 = ListItem(List=panel, Index=panel_3, Wrap=True)
resulting_line = Line(StartPoint=item, EndPoint=item_2)
mandala = GhPythonScript(mandala=resulting_line, radius=number_slider_2)  # -> out, a, path, planes; inputs mandala: list of Line, radius: Int32
# ---------- mandala: Python ----------
import rhinoscriptsyntax as rs
from compas.geometry import Point, Vector, Frame
from compas.artists import Artist
from compas.geometry import Transformation

x_Axis = Vector(1, 0, 0)
y_Axis = Vector(0, -1, 0)
z_Axis = Vector(0, 0, 1)

safe_level = 0.03

# ToDo: coordinate system picture
picuture_coordinate_system = Frame(Point(0, 0, 0), x_Axis, y_Axis)

#Frame infront picture
starting_pos = Frame(Point(radius/2, radius/2, radius/2), x_Axis, y_Axis)
#starting_pos = picuture_coordinate_system.to_local_coordinates(starting_pos)

path = []
for i, line in enumerate(mandala):
    if line.From == line.To:
        continue
    
    frame_from_up = Frame(Point(line.From.X, line.From.Y, line.From.Z + safe_level), x_Axis, y_Axis)

    frame_from = Frame(Point(line.From.X, line.From.Y, line.From.Z), x_Axis, y_Axis)
    frame_to = Frame(Point(line.To.X, line.To.Y, line.To.Z), x_Axis, y_Axis)
    
    frame_to_up = Frame(Point(line.To.X, line.To.Y, line.To.Z + safe_level), x_Axis, y_Axis)

    path.append(frame_from_up)
    path.append(frame_from)
    path.append(frame_to)
    path.append(frame_to_up)

print len(path)

planes = [Artist(frame).draw() for frame in path]
# ---------- end mandala ----------
panel_4 = Panel(mandala.path)

reload = Button()
path = PythonScript()  # -> HERE, DATA, ROBOT_DESCRIPTION
# ---------- path: Python ----------
import os

HERE = os.path.dirname(ghdoc.Path)
DATA = os.path.abspath(os.path.join(HERE, "..", "data"))
ROBOT_DESCRIPTION = os.path.abspath(os.path.join(DATA, "robot_description"))

print(HERE)
print(DATA)
print(ROBOT_DESCRIPTION)
# ---------- end path ----------
py = PythonScript(reload=reload)
# ---------- py: Python ----------
from compas_ghpython import unload_modules

if reload:
    unload_modules("abb_fabrication_control")
    unload_modules("compas_rrc")
# ---------- end py ----------

# ----
# ROS client
robot_port = ValueList({"9090", "30101"}, selected="9090")
ip = ValueList({"127.0.0.1", "192.168.0.4", "10.181.79.113"}, selected="127.0.0.1")
ros = ROSConnect(ip=ip, port=robot_port, connect=Toggle(True))  # -> ros_client, is_connected; inputs port: Int32, connect: Boolean
#   port ip: The ip address ROS. Defaults to 127.0.0.1.
# ---------- ros: Python ----------
from ghpythonlib.componentbase import executingcomponent as component
from scriptcontext import sticky as st

from compas_fab.backends import RosClient
from compas_fab.ghpython.components import create_id


class ROSConnect(component):
    def RunScript(self, ip, port, connect):
        ros_client = None

        ip = ip or '127.0.0.1'
        port = port or 9090

        key = create_id(self, 'ros_client')
        ros_client = st.get(key, None)

        if ros_client:
            st[key].close()
        if connect:
            st[key] = RosClient(ip, port)
            st[key].run(5)

        ros_client = st.get(key, None)
        is_connected = ros_client.is_connected if ros_client else False
        return (ros_client, is_connected)
# ---------- end ros ----------
is_connected = Panel(ros.is_connected)

# ----
# Tool Path
pln = Plane(mandala.planes)

reset = Button()
back = Button()
start = Button()
stop = Button()
step = Button()
full = Button()
list = ValueList({"20", "50", "100", "500", "1000", "5000"}, selected="500")

# ----
# Draw
counter = CountThroughList(planes=pln, start=start, stop=stop, step=step, step_back=back, reset=reset, full=full, interval=list)  # -> item, counter; inputs planes: list of Plane, start: Boolean, stop: Boolean, step_back: Boolean
# ---------- counter: Python ----------
from scriptcontext import sticky as st
from compas_ghpython import update_component


L = planes
# store data in component
guid = str(ghenv.Component.InstanceGuid)
counter_key = "counter_" + guid
running_key = "running_" + guid

if counter_key not in st:
    st[counter_key] = 0

if running_key not in st:
    st[running_key] = False
    

if st[running_key]:
    if st[counter_key] < len(L) - 1:
        st[counter_key] += 1
        update_component(ghenv, interval)
    else:
        st[counter_key] = 0
        st[running_key] = False
    
    
if start:
    st[running_key] = True

if stop:
    st[running_key] = False

if step:
    if st[counter_key] < len(L) - 1:
        st[counter_key] += 1

if step_back:
    if st[counter_key] < len(L):
        st[counter_key] -= 1

if reset:
    st[counter_key] = 0

if full:
    st[counter_key] = len(L)-1

if len(L):
    item = L[st[counter_key]]



#st["visualisation_counter"] = st[counter_key]
#st[counter_key]= 500
counter = st[counter_key]
# ---------- end counter ----------
idx = Panel(counter.counter)

# ---- group: Planes Viz
show = BooleanToggle(False)
show_2 = BooleanToggle(True)
draw = PythonScript(planes=pln, show_all=show, show_counter=show_2, counter=counter.counter)  # -> G; inputs planes: list, counter: Int32
# ---------- draw: Python ----------
import os
import sys

import math

from compas.artists import Artist

G = []


if show_all and not show_counter:
    for plane in planes:
        G.append(plane)

if show_counter:
    for plane in planes[0:counter+1]:
        G.append(plane)
# ---------- end draw ----------
pln_2 = Plane(draw)

# ----
abb = GhPythonScript(ros_client=ros.ros_client, connect=Toggle(True))  # -> out, abb_client; inputs connect: Boolean
# ---------- abb: Python ----------
import compas_rrc as rrc

if ros_client:
    if ros_client.is_connected and connect: 
        # Create ABB Client
        abb_client = rrc.AbbClient(ros_client, '/rob1')
# ---------- end abb ----------

number_slider_3 = Slider(3, range=0..10)  # disabled
number_slider_4 = Slider(2, range=0..4)  # disabled
crv = Curve(<curve referenced from the Rhino model>)  # disabled
frames = CurveFrames(Curve=crv, Count=number_slider_3)  # -> Frames, Parameters; disabled
item_3 = ListItem(List=frames.Frames, Index=number_slider_4, Wrap=True)  # disabled

to_planes = Button()
to_plane = Button()
target_planes = Plane(pln)

get_frame = Button()
get_joints = Button()

set_state = Button()
state = BooleanToggle(False)

# ----
# Tool
panel_5 = Panel("Attach a custom tool")
list_2 = ValueList({"measurement_tool": 0, "sgraffito_tool": 1, "shooting_tool": 2, "stift_tool": 3}, selected="stift_tool")
remove = Button()
add = Button()
tools = Tools(G=list_2)

# ----
# Load Model
# Load robot from local package
load = Button()
list_3 = ValueList({"abb_crb15000"}, selected="abb_crb15000")
units = ValueList({"m": 1, "cm": 100, "mm": 1000}, selected="m")

# ----
# Robot Model
panel_6 = Panel("abb_crb15000_5_95.srdf")

load_model = PythonScript(
    path=path.ROBOT_DESCRIPTION,
    package=list_3,
    urdf_name="abb_crb15000_5_95.urdf",
    srdf_name=panel_6,
    scale_factor=units,
    load=load)  # -> robot
# ---------- load_model: Python ----------
import os
from scriptcontext import sticky as st
import compas
from compas.robots import RobotModel
from compas.robots import LocalPackageMeshLoader
from compas_fab.robots import Robot
from compas_fab.robots import RobotSemantics
from compas_fab.ghpython import RobotArtist

packages = ["abb_crb15000_support", "abb_end_effectors", "abb_crb15000"]
loaders = []

for package in packages:
    loaders.append(LocalPackageMeshLoader(path, package))

#path directory
package_path = os.path.join(path, package)
print(package_path)

urdf_filename = os.path.join(package_path, "urdf", urdf_name)
srdf_filename = os.path.join(package_path, srdf_name)

assert os.path.isfile(urdf_filename)
assert os.path.isfile(srdf_filename)

compas.PRECISION = '12f'

# store robot in component
guid = str(ghenv.Component.InstanceGuid)
robot_key = "robot_" + guid

if robot_key not in st:
    st[robot_key] = None

#load robot model from urdf
if load:
    model = RobotModel.from_urdf_file(urdf_filename)
    model.load_geometry(*loaders)
    artist = RobotArtist(model)
    semantics = RobotSemantics.from_srdf_file(srdf_filename, model)
    robot = Robot(model, artist, semantics, client=None)

    st[robot_key] = robot
robot = st[robot_key]

#vizualize robot in the right scale of your environment
robot.scale(scale_factor)
# ---------- end load_model ----------

attach_remove = PythonScript(robot=load_model, tool=tools, attach=add, remove=remove)  # -> out, bang
# ---------- attach_remove: Python ----------
if attach:
    robot.attach_tool(tool)
if remove:
    robot.detach_tool()
# ---------- end attach_remove ----------

set = PythonScript(robot=load_model, ros_client=ros.ros_client, abb_client=abb.abb_client)  # -> out, robot, main_group_name
# ---------- set: Python ----------
if robot and ros_client and abb_client:
    robot.ros_client = ros_client
    robot.abb_client = abb_client

    robot.info()
    main_group_name = robot.main_group_name
# ---------- end set ----------
robot_info = Panel(set.out)

# ----
# Configuration
# Forward kinematics
number_slider_5 = Slider(-7.6, range=-180..180)
jp = GhPythonScript()  # -> configuration_values
# ---------- jp: Python ----------
import math
joint_values = [-0.132, 0.416, 0.663, 0.056, 0.503, 0.038]
#joint_values = [math.degrees(j) for j in joint_values]
#joint_values = [math.degrees(j) for j in joint_values]
#joint_positions = [0] * 6


joint_values = [0,0,0,0,0,0]

#conf = Configuration((-0.132, 0.416, 0.663, 0.056, 0.503, 0.038), (0, 0, 0, 0, 0, 0), ('joint_1', 'joint_2', 'joint_3', 'joint_4', 'joint_5', 'joint_6'))


configuration_values = joint_values
# ---------- end jp ----------
forward_kinematics = PythonScript(
    robot=set.robot,
    reset_configuration=Button(),
    configuration_values=jp,
    a_a1=number_slider_5,
    a_a2=Slider(23.8, range=-180..180),
    a_a3=Slider(38, range=-225..85),
    a_a4=Slider(3.2, range=-180..180),
    a_a5=Slider(28.8, range=-180..180),
    a_a6=Slider(2.2, range=-270..270))  # -> full_configuration; inputs reset_configuration: Boolean, configuration_values: list
# ---------- forward_kinematics: Python ----------
import math
import Grasshopper
import copy
from compas.robots import Joint
from compas_fab.robots import Configuration





if reset_configuration:
    j = 0
    for i in range(ghenv.Component.Params.Input.Count):
        nslider = ghenv.Component.Params.Input[i].Sources[0]
        if nslider.GetType() == Grasshopper.Kernel.Special.GH_NumberSlider:
            nslider.TrySetSliderValue(configuration_values[j])
            j += 1


if robot:
    joint_positions = [a_a1, a_a2, a_a3, a_a4, a_a5, a_a6]
    print joint_positions
    joint_positions_degrees = copy.deepcopy(joint_positions)
    joint_types = robot.get_configurable_joint_types()
    print(joint_types)
    for i, joint_type in enumerate(joint_types):
        if joint_type == Joint.REVOLUTE:
            joint_positions[i] = math.radians(joint_positions[i])
        if joint_type == Joint.PRISMATIC:
            joint_positions[i] = joint_positions[i]
    full_configuration = Configuration(joint_positions, joint_types)
    print full_configuration
# ---------- end forward_kinematics ----------

# ----
# Inverse kinematics
py_2 = PythonScript(robot=set.robot)  # -> configuration
# ---------- py_2: Python ----------
from compas_fab.robots import Configuration

if robot:
    types = robot.get_configurable_joint_types()
    values = [0] * len(types)
    configuration = Configuration(values, types)
    print configuration
    print robot.get_configurable_joint_names()
# ---------- end py_2 ----------
x_axis = Curve(<curve referenced from the Rhino model>)
y_axis = Curve(<curve referenced from the Rhino model>)
go_to_start_configuration = BooleanToggle(False)
fk_configuration = Data(forward_kinematics)
list_4 = ValueList({"0", "1"}, selected="0")
avoid_collisions = BooleanToggle(False)
plane = PythonScript(plane_axes=[x_axis, y_axis])  # -> plane; inputs plane_axes: list of Curve
# ---------- plane: Python ----------
import Rhino.Geometry as rg

x_axis, y_axis = plane_axes

x_axis = rg.Line(x_axis.PointAtStart, x_axis.PointAtEnd)
y_axis = rg.Line(y_axis.PointAtStart, y_axis.PointAtEnd)

if x_axis.From.DistanceTo(y_axis.From) < 0.01:
    origin = x_axis.From
    xvec = x_axis.Direction
    yvec = y_axis.Direction
elif x_axis.To.DistanceTo(y_axis.To) < 0.01:
    origin = x_axis.To
    xvec = -x_axis.Direction
    yvec = -y_axis.Direction
elif x_axis.From.DistanceTo(y_axis.To) < 0.01:
    origin = x_axis.From
    xvec = x_axis.Direction
    yvec = -y_axis.Direction
elif x_axis.To.DistanceTo(y_axis.From) < 0.01:
    origin = x_axis.To
    xvec = -x_axis.Direction
    yvec = y_axis.Direction

plane = rg.Plane(origin, xvec, yvec)
# ---------- end plane ----------
compute = BooleanToggle(True)
filter = StreamFilter(Gate=list_4, Stream0=fk_configuration, Stream1=py_2)
inverse_kinematics = GhPythonScript(
    compute=compute,
    robot=set.robot,
    group=set.main_group_name,
    plane=counter.item,
    start_configuration=filter,
    go_to_start_configuration=go_to_start_configuration,
    avoid_collisions=avoid_collisions)  # -> out, ik_configuration, t0cp; inputs plane: Plane
# ---------- inverse_kinematics: Python ----------
from __future__ import print_function
import logging
from scriptcontext import sticky as st

from compas.geometry import Frame
from compas_ghpython.artists import Artist

LOGGER = logging.getLogger('roslibpy')

#vizualize t0cf
if robot.attached_tool:
    t0cf = Frame(plane.Origin, plane.XAxis, plane.YAxis)
    #t0cf = robot.from_tcf_to_t0cf([t0cf])[0]
    t0cp = Artist(t0cf).draw()
    print (t0cf)


if compute:
    if robot.attached_tool:
        tool_attached = True
    else:
        tool_attached = False

    robot.client = robot.ros_client
    if go_to_start_configuration:
        ik_configuration = start_configuration
    else:
        frame = Frame(plane.Origin, plane.XAxis, plane.YAxis)
#        if tool_attached:
#            tool_frame = robot.from_tcf_to_t0cf([frame])[0]
#        else:
#            tool_frame = frame

        ik_configuration = robot.inverse_kinematics(frame,
                                                      start_configuration,
                                                      group=group,
                                                      options={
                                                        'avoid_collisions':avoid_collisions,
                                                        'return_full_configuration':True,
                                                      })        
    #group_configuration = robot.get_group_configuration(group, ik_configuration)
    #print (group_configuration)
    st["ik_configuration"] = ik_configuration

ik_configuration = st["ik_configuration"] 
print(ik_configuration)
# ---------- end inverse_kinematics ----------
draw_2 = GhPythonScript(planes=inverse_kinematics.t0cp, scale=Slider(0.2, range=0..1))  # -> P, V, C, W; inputs planes: list
# ---------- draw_2: Python ----------
from System.Drawing import Color
from compas_ghpython.artists import FrameArtist

red = Color.FromArgb(255, 0, 0)
green = Color.FromArgb(0, 255, 0)
blue = Color.FromArgb(0, 0, 255)

P = []
V = []
C = []

scale = float(scale)

for plane in planes:
    if not plane:
        continue
    P += [plane.Origin] * 3
    V.append(plane.XAxis * scale)
    V.append(plane.YAxis * scale)
    V.append(plane.ZAxis * scale)
    C += [red, green, blue]

W = 3
# ---------- end draw_2 ----------
out = Panel(inverse_kinematics.ik_configuration)
vdisex = VectorDisplayEx(Point=draw_2.P, Vector=draw_2.V, Colour=draw_2.C, Width=draw_2.W)

# ----
# Move Cartesian
tcp_speed = Slider(40, range=0..1000)
target_plane = Plane(pln_2)
movel_command = GhPythonScript(
    robot=set.robot,
    speed=tcp_speed,
    target_plane=target_plane,
    target_planes=target_planes,
    move_to_planes=to_planes,
    move_to_plane=to_plane,
    set_tool=add)  # -> out; inputs target_plane: Plane, target_planes: list, move_to_plane: Boolean
# ---------- movel_command: Python ----------
import compas_rrc as rrc
import abb_fabrication_control as afc
from compas.geometry import Frame, Rotation
import math
from compas.artists import Artist


#sets tool in RobotStudio
if set_tool:
    if robot.attached_tool:
        tool_name = robot.attached_tool.name
        print tool_name
        done = robot.abb_client.send(rrc.SetTool(tool_name))
        print done
    else:
        robot.abb_client.send(rrc.SetTool("tool0"))


if move_to_plane:
    target_frame = Frame(target_plane.Origin, target_plane.XAxis, target_plane.YAxis)
    afc.commands.move_to_frame(robot, target_frame, speed=speed, zone=rrc.Zone.FINE, motion_type='L', scalefactor=1000, send_and_wait=False)


if move_to_planes:
    for target_plane in target_planes:
        target_frame = Frame(target_plane.Origin, target_plane.XAxis, target_plane.YAxis)
        afc.commands.move_to_frame(robot, target_frame, speed=speed, zone=rrc.Zone.FINE, motion_type='L', scalefactor=1000, send_and_wait=False)
# ---------- end movel_command ----------
data_recorder = DataRecorder(movel_command, DataLimit=-10, RecordData=True)
out_2 = Panel(data_recorder)

list_5 = ValueList({"0 forward_kinematics": 0, "1 inverse_kinematics": 1}, selected="1 inverse_kinematics")
fk_configuration_2 = Data(forward_kinematics)
ik_configuration = Data(inverse_kinematics.ik_configuration)
filter_2 = StreamFilter(Gate=list_5, Stream0=fk_configuration_2, Stream1=ik_configuration)

# ----
# Move Joints
tcp_speed_2 = Slider(39, range=0..1000)
to_joints = Button()
movej_command = GhPythonScript(robot=set.robot, configuration=filter_2, speed=tcp_speed_2, move_to_joints=to_joints)  # -> out; inputs move_to_joints: Boolean
# ---------- movej_command: Python ----------
import abb_fabrication_control as afc
import compas_rrc as rrc



if move_to_joints:
    afc.commands.move_to_joints(robot, configuration, speed=speed, zone=rrc.Zone.FINE)
# ---------- end movej_command ----------
data_recorder_2 = DataRecorder(movej_command, DataLimit=-10, RecordData=True)
out_3 = Panel(data_recorder_2)

# ----
# Visualisation
# Robot Control
show_end_effector_frame = BooleanToggle(True)
show_base_frame = BooleanToggle(False)
show_collision = BooleanToggle(False)
show_frames = BooleanToggle(False)
show_visual = BooleanToggle(True)
show_acm = BooleanToggle(False)
robot_visualize = RobotVisualize(
    robot=set.robot,
    group=set.main_group_name,
    configuration=filter_2,
    redraw=attach_remove.bang,
    show_visual=show_visual,
    show_collision=show_collision,
    show_frames=show_frames,
    show_base_frame=show_base_frame,
    show_end_effector_frame=show_end_effector_frame,
    show_acm=show_acm)  # -> visual, collision, attached_meshes, frames, base_frame, ee_frame; inputs redraw: list, show_visual: Boolean, show_collision: Boolean, show_frames: Boolean, show_base_frame: Boolean, show_end_effector_frame: Boolean, show_acm: Boolean
#   port group: The planning group used for end-effector and base visualization.
#   port configuration: The robot's full configuration.
#   port redraw: A list of attached collision meshes.
#   port show_visual: Whether or not to show the robot's visual meshes.
#   port show_collision: Whether or not to show the robot's collision meshes.
#   port show_frames: Whether or not to show the robot's joint frames.
#   port show_base_frame: Whether or not to show the robot's base frame.
#   port show_end_effector_frame: Whether or not to show the robot's end-effector frame.
#   port show_acm: Whether or not to show the attached collision meshes (if any).
#   port visual: The robot's visual Rhino meshes (if any).
#   port collision: The robot's collision Rhino meshes (if any).
#   port attached_meshes: The attached collision Rhino meshes (if any).
#   port frames: The robot's joint frames as Rhino planes (if any).
#   port base_frame: The robot's base frame as a Rhino plane (if any).
#   port ee_frame: The robot's end-effector frame as a Rhino plane (if any).
# ---------- robot_visualize: Python ----------
"""
Visualizes the robot.

COMPAS FAB v0.19.1
"""
from compas.geometry import Frame
from compas.geometry import Transformation
from compas_ghpython.artists import Artist
from ghpythonlib.componentbase import executingcomponent as component


class RobotVisualize(component):
    def RunScript(self, robot, group, configuration, attached_collision_meshes, show_visual, show_collision,
                  show_frames, show_base_frame, show_end_effector_frame, show_acm):

        visual = None
        collision = None
        attached_meshes = None
        frames = None
        base_frame = None
        ee_frame = None

        if robot:
            show_visual = True if show_visual is None else show_visual
            configuration = configuration or robot.zero_configuration()

            robot.update(configuration, visual=show_visual, collision=show_collision)
            compas_frames = robot.transformed_frames(configuration, group)

            if show_visual:               
                visual = robot.artist.draw_visual()
                

            if show_collision:
                collision = robot.artist.draw_collision()

            if show_base_frame:
                base_compas_frame = compas_frames[0]
                base_frame = Artist(base_compas_frame).draw()

            if show_end_effector_frame:
                ee_compas_frame = robot.forward_kinematics(configuration, group, options=dict(solver='model'))
                ee_frame = Artist(ee_compas_frame).draw()

            if show_frames:
                frames = []
                for compas_frame in compas_frames[1:]:
                    frame = Artist(compas_frame).draw()
                    frames.append(frame)

            if show_acm:
                attached_meshes = []
                for acm in attached_collision_meshes:
                    frame = robot.forward_kinematics(configuration, options=dict(solver='model', link_name=acm.link_name))
                    T = Transformation.from_frame_to_frame(Frame.worldXY(), frame)
                    mesh = acm.collision_mesh.mesh.transformed(T)
                    attached_meshes.append(Artist(mesh).draw())

        return (visual, collision, attached_meshes, frames, base_frame, ee_frame)
# ---------- end robot_visualize ----------
draw_3 = GhPythonScript(frames=[robot_visualize.frames, robot_visualize.base_frame, robot_visualize.ee_frame], scale=Slider(0.2, range=0..1))  # -> P, V, C, W; inputs frames: list
# ---------- draw_3: Python ----------
from System.Drawing import Color
from compas_ghpython.artists import FrameArtist

red = Color.FromArgb(255, 0, 0)
green = Color.FromArgb(0, 255, 0)
blue = Color.FromArgb(0, 0, 255)

P = []
V = []
C = []

scale = float(scale)

for plane in frames:
    if not plane:
        continue
    P += [plane.Origin] * 3
    V.append(plane.XAxis * scale)
    V.append(plane.YAxis * scale)
    V.append(plane.ZAxis * scale)
    C += [red, green, blue]

W = 3
# ---------- end draw_3 ----------
geo = Geometry([robot_visualize.visual, robot_visualize.collision, robot_visualize.attached_meshes])
preview = CustomPreview(Geometry=geo, Shader=ColourSwatch(SwatchColor=RGB(207, 157, 160)))
vdisex_2 = VectorDisplayEx(Point=draw_3.P, Vector=draw_3.V, Colour=draw_3.C, Width=draw_3.W)

# ----
# Feedback
get_joints_2 = GhPythonScript(robot=set.robot, get_frame=get_frame, get_joints=get_joints, set_tool=attach_remove.bang)  # -> joint, current_configuration, current_plane
# ---------- get_joints_2: Python ----------
from scriptcontext import sticky as st
import abb_fabrication_control as afc
from compas.robots import Configuration
import os
import compas_rrc as rrc

from compas.artists import Artist

guid = str(ghenv.Component.InstanceGuid)
current_frame = "current_frame" + guid
current_configuration = "current_configuration" + guid

#sets tool in RobotStudio
if set_tool:
    if robot.attached_tool:
        tool_name = robot.attached_tool.name
        print tool_name
        done = robot.abb_client.send(rrc.SetTool(tool_name))
        print done
    else:
        robot.abb_client.send(rrc.SetTool("tool0"))

if get_frame:
    current_frame = afc.feedback.get_frame(robot, scalefactor=0.001)
    st[current_frame] = current_frame

if get_joints:
    current_configuration = afc.feedback.get_joints(robot)
    st[current_configuration] = current_configuration

if current_frame not in st:
    current_frame = []
else:
    current_frame = st[current_frame]
    current_plane = Artist(current_frame).draw()
    print current_plane

if current_configuration not in st:
    current_configuration = []
else:
    current_configuration = st[current_configuration]
    print current_configuration
# ---------- end get_joints_2 ----------
data_recorder_3 = DataRecorder(get_joints_2.joint, DataLimit=-10, RecordData=True)
panel_7 = Panel(data_recorder_3)
draw_4 = GhPythonScript(plane=get_joints_2.current_plane, scale=Slider(0.2, range=0..1))  # -> P, V, C, W; inputs plane: Plane
# ---------- draw_4: Python ----------
from System.Drawing import Color
from compas_ghpython.artists import FrameArtist

red = Color.FromArgb(255, 0, 0)
green = Color.FromArgb(0, 255, 0)
blue = Color.FromArgb(0, 0, 255)

P = []
V = []
C = []

scale = float(scale)


if plane:
    P += [plane.Origin] * 3
    V.append(plane.XAxis * scale)
    V.append(plane.YAxis * scale)
    V.append(plane.ZAxis * scale)
    C += [red, green, blue]
    
    W = 3
# ---------- end draw_4 ----------
vdisex_3 = VectorDisplayEx(Point=draw_4.P, Vector=draw_4.V, Colour=draw_4.C, Width=draw_4.W)

# ----
# Set Digital Output
do = GhPythonScript(robot=set.robot, io_name="doAirOnOff", state=state, set_state=set_state)  # -> out
# ---------- do: Python ----------
import rhinoscriptsyntax as rs
import compas_rrc as rrc


if state and set_state:
    rrc.SetDigital(io_name, 1, feedback_level=0)
else:
    rrc.SetDigital(io_name, 0, feedback_level=0)
# ---------- end do ----------
data_recorder_4 = DataRecorder(do, DataLimit=-10, RecordData=True)
out_4 = Panel(data_recorder_4)

# ==== cluster Tools

# ---- group: measurement tool
geo = Geometry(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)
mesh = Mesh(geo)
mjoin = MeshJoin(Meshes=mesh)
xaxis_line = Curve(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)
yaxis_line = Curve(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)
tool = PythonScript(rhmesh=mjoin, xline=xaxis_line, yline=yaxis_line)  # -> tool; inputs rhmesh: Mesh
# ---------- tool: Python ----------
import Rhino.Geometry as rg
import os, math
from compas.geometry import Frame, Rotation
from compas.datastructures import Mesh
from compas_ghpython.artists import MeshArtist
from compas_fab.robots import Tool
from compas_rhino.geometry import RhinoMesh

xaxis = rg.Line(xline.PointAtStart, xline.PointAtEnd)
yaxis = rg.Line(yline.PointAtStart, yline.PointAtEnd)

if xaxis.From.DistanceTo(yaxis.From) < 0.01:
    origin = xaxis.From
    xaxis = xaxis.Direction
    yaxis = yaxis.Direction
elif xaxis.To.DistanceTo(yaxis.To) < 0.01:
    origin = xaxis.To
    xaxis = -xaxis.Direction
    yaxis = -yaxis.Direction
elif xaxis.From.DistanceTo(yaxis.To) < 0.01:
    origin = xaxis.From
    xaxis = xaxis.Direction
    yaxis = -yaxis.Direction
elif xaxis.To.DistanceTo(yaxis.From) < 0.01:
    origin = xaxis.To
    xaxis = -xaxis.Direction
    yaxis = yaxis.Direction

xaxis.Unitize()
yaxis.Unitize()

ee_frame = Frame(origin, xaxis, yaxis)
ee_mesh = RhinoMesh.from_geometry(rhmesh).to_compas()

tool = Tool(ee_mesh, ee_frame, collision=None, name="t_measurement")


values_for_robotstudio = [[round(entry*1000, 5) for entry in list(ee_frame.point)], list(ee_frame.quaternion)]
print values_for_robotstudio

print ee_frame.quaternion.x
print ee_frame.quaternion.y
print ee_frame.quaternion.z
print ee_frame.quaternion.w
# ---------- end tool ----------

# ---- group: sgraffito tool
geo_2 = Geometry(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)
mesh_2 = Mesh(geo_2)
mjoin_2 = MeshJoin(Meshes=mesh_2)
yaxis_line_2 = Curve(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)
xaxis_line_2 = Curve(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)

# ---- group: shooting tool
geo_3 = Geometry([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])
mesh_3 = Mesh(geo_3)
mjoin_3 = MeshJoin(Meshes=mesh_3)
yaxis_line_3 = Curve(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)
xaxis_line_3 = Curve(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)

# ---- group: stift tool
geo_4 = Geometry(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)
mesh_4 = Mesh(geo_4)
mjoin_4 = MeshJoin(Meshes=mesh_4)
xaxis_line_4 = Curve(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)
yaxis_line_4 = Curve(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)
tool_2 = PythonScript(rhmesh=mjoin_4, xline=xaxis_line_4, yline=yaxis_line_4)  # -> tool; inputs rhmesh: Mesh
# ---------- tool_2: Python ----------
import Rhino.Geometry as rg
import os, math
from compas.geometry import Frame, Rotation
from compas.datastructures import Mesh
from compas_ghpython.artists import MeshArtist
from compas_fab.robots import Tool
from compas_rhino.geometry import RhinoMesh

xaxis = rg.Line(xline.PointAtStart, xline.PointAtEnd)
yaxis = rg.Line(yline.PointAtStart, yline.PointAtEnd)

if xaxis.From.DistanceTo(yaxis.From) < 0.01:
    origin = xaxis.From
    xaxis = xaxis.Direction
    yaxis = yaxis.Direction
elif xaxis.To.DistanceTo(yaxis.To) < 0.01:
    origin = xaxis.To
    xaxis = -xaxis.Direction
    yaxis = -yaxis.Direction
elif xaxis.From.DistanceTo(yaxis.To) < 0.01:
    origin = xaxis.From
    xaxis = xaxis.Direction
    yaxis = -yaxis.Direction
elif xaxis.To.DistanceTo(yaxis.From) < 0.01:
    origin = xaxis.To
    xaxis = -xaxis.Direction
    yaxis = yaxis.Direction

xaxis.Unitize()
yaxis.Unitize()

ee_frame = Frame(origin, xaxis, yaxis)
ee_mesh = RhinoMesh.from_geometry(rhmesh).to_compas()

tool = Tool(ee_mesh, ee_frame, collision=None, name="t_stift")


values_for_robotstudio = [[round(entry*1000, 5) for entry in list(ee_frame.point)], list(ee_frame.quaternion)]
print values_for_robotstudio

print ee_frame.quaternion.x
print ee_frame.quaternion.y
print ee_frame.quaternion.z
print ee_frame.quaternion.w
# ---------- end tool_2 ----------

# ----
tool_3 = PythonScript(rhmesh=mjoin_2, xline=xaxis_line_2, yline=yaxis_line_2)  # -> tool; inputs rhmesh: Mesh
# ---------- tool_3: Python ----------
import Rhino.Geometry as rg
import os, math
from compas.geometry import Frame, Rotation
from compas.datastructures import Mesh
from compas_ghpython.artists import MeshArtist
from compas_fab.robots import Tool
from compas_rhino.geometry import RhinoMesh

xaxis = rg.Line(xline.PointAtStart, xline.PointAtEnd)
yaxis = rg.Line(yline.PointAtStart, yline.PointAtEnd)

if xaxis.From.DistanceTo(yaxis.From) < 0.01:
    origin = xaxis.From
    xaxis = xaxis.Direction
    yaxis = yaxis.Direction
elif xaxis.To.DistanceTo(yaxis.To) < 0.01:
    origin = xaxis.To
    xaxis = -xaxis.Direction
    yaxis = -yaxis.Direction
elif xaxis.From.DistanceTo(yaxis.To) < 0.01:
    origin = xaxis.From
    xaxis = xaxis.Direction
    yaxis = -yaxis.Direction
elif xaxis.To.DistanceTo(yaxis.From) < 0.01:
    origin = xaxis.To
    xaxis = -xaxis.Direction
    yaxis = yaxis.Direction

xaxis.Unitize()
yaxis.Unitize()

ee_frame = Frame(origin, xaxis, yaxis)
ee_mesh = RhinoMesh.from_geometry(rhmesh).to_compas()

tool = Tool(ee_mesh, ee_frame, collision=None, name="t_sgraffito")

values_for_robotstudio = [[round(entry*1000, 5) for entry in list(ee_frame.point)], list(ee_frame.quaternion)]
print values_for_robotstudio


print ee_frame.quaternion.x
print ee_frame.quaternion.y
print ee_frame.quaternion.z
print ee_frame.quaternion.w
# ---------- end tool_3 ----------
tool_4 = PythonScript(rhmesh=mjoin_3, xline=xaxis_line_3, yline=yaxis_line_3)  # -> tool; inputs rhmesh: Mesh; same code as tool_3
G = ClusterInput()
filter = StreamFilter(Gate=G, Stream0=tool, Stream1=tool_3, Stream2=tool_4, Stream3=tool_2)
s_3 = ClusterOutput(filter)
