# Grasshopper definition ex1_toolpath_gen.ghx (Grasshopper 1.0.7)

# ----
# Tool Path
x = Slider(0, range=0..10)
y = Slider(9, range=0..10)
pln = Plane(PlaneXY(0, 0, 0))
python = GhPythonScript(
    plane=pln,
    steps=Slider(25, range=0..100),
    change_depth=Toggle(True),
    depth=Slider(0.003, range=0..0.01),
    angle_x=x,
    angle_y=y)  # -> out, planes; inputs steps: Int32
# ---------- python: Python ----------
from compas.geometry import Frame, Translation, Rotation
from compas.artists import Artist
import rhinoscriptsyntax as rs
import math

planes = []

for i in range(steps):
    frame = Frame(plane.Origin, plane.XAxis, -plane.YAxis)
    T = Translation.from_vector(frame.xaxis*0.05*i)
    if i % 2 == 0:
        T1 = Translation.from_vector(frame.zaxis*0.0)
        R1 = Rotation.from_axis_and_angle(frame.xaxis, math.radians(angle_x), frame.point)
        R2 = Rotation.from_axis_and_angle(frame.yaxis, math.radians(-angle_y), frame.point)
#    elif i % 2 == 0 and i > 3:
#        T1 = Translation.from_vector(frame.zaxis*0.0)
#        R1 = Rotation.from_axis_and_angle(frame.xaxis, math.radians(angle_x), frame.point)
#        R2 = Rotation.from_axis_and_angle(frame.yaxis, math.radians(angle_y), frame.point)
    else:
        if change_depth:
            T1 = Translation.from_vector(frame.zaxis*depth)
        else:
            T1 = Translation.from_vector(frame.zaxis*0)
        R1 = Rotation.from_axis_and_angle(frame.xaxis, math.radians(-angle_x), frame.point)
        R2 = Rotation.from_axis_and_angle(frame.yaxis, math.radians(0), frame.point)
    frame.transform(T*T1*R1*R2)
    planes.append(Artist(frame).draw())
# ---------- end python ----------

reset = Button()
back = Button()
start = Button()
stop = Button()
step = Button()
full = Button()
list = ValueList({"20", "50", "100", "500", "1000", "5000"}, selected="500")

# ----
# Draw
counter = CountThroughList(planes=python.planes, start=start, stop=stop, step=step, step_back=back, reset=reset, full=full, interval=list)  # -> item, counter; inputs planes: list of Plane, start: Boolean, stop: Boolean, step_back: Boolean
# ---------- counter: Python ----------
from scriptcontext import sticky as st
from compas_ghpython import update_component


L = planes
# store data in component
guid = str(ghenv.Component.InstanceGuid)
counter_key = "counter_" + guid
running_key = "running_" + guid

if counter_key not in st:
    st[counter_key] = 0

if running_key not in st:
    st[running_key] = False
    

if st[running_key]:
    if st[counter_key] < len(L) - 1:
        st[counter_key] += 1
        update_component(ghenv, interval)
    else:
        st[counter_key] = 0
        st[running_key] = False
    
    
if start:
    st[running_key] = True

if stop:
    st[running_key] = False

if step:
    if st[counter_key] < len(L) - 1:
        st[counter_key] += 1

if step_back:
    if st[counter_key] < len(L):
        st[counter_key] -= 1

if reset:
    st[counter_key] = 0

if full:
    st[counter_key] = len(L)-1

if len(L):
    item = L[st[counter_key]]



#st["visualisation_counter"] = st[counter_key]
#st[counter_key]= 500
counter = st[counter_key]
# ---------- end counter ----------
idx = Panel(counter.counter)

# ---- group: Planes Viz
show = BooleanToggle(False)
show_2 = BooleanToggle(True)
draw = PythonScript(planes=python.planes, show_all=show, show_counter=show_2, counter=counter.counter)  # -> G; inputs planes: list, counter: Int32
# ---------- draw: Python ----------
import os
import sys

import math

from compas.artists import Artist

G = []


if show_all and not show_counter:
    for plane in planes:
        G.append(plane)

if show_counter:
    for plane in planes[0:counter+1]:
        G.append(plane)
# ---------- end draw ----------
pln_2 = Plane(draw)

# ----
pline = PolyLine(Vertices=pln_2, Closed=False)
crv = Curve(<curve referenced from the Rhino model>)
crv_2 = Curve(<curve referenced from the Rhino model>)
extrcrv = ExtrudeAlong(Base=pline, Curve=crv)

brep = Brep(<brep referenced from the Rhino model>)  # disabled
brep_2 = Brep(extrcrv)
sdiff = SolidDifference(BrepsA=brep, BrepsB=brep_2)  # disabled
