# Grasshopper definition sgraffito_paths_planner_craft.gh (Grasshopper 1.0.7)

# ---- group: Generating curve and dividing into segments
segments = Slider(9, range=0..100)
pt = Point([Point(80.73803832, -50.33010593, 0), Point(79.58608967, -157.1983208, 0)])
dividecurve = GhPythonScript(x=pt, y=segments)  # -> out, a, b; inputs x: list
# ---------- dividecurve: Python ----------
__author__ = "ILarikova"
__version__ = "2023.01.30"


import rhinoscriptsyntax as rs

pnts = rs.coerce3dpointlist(x)
a = rs.AddCurve(x)

b = rs.DivideCurve(a, y)
# ---------- end dividecurve ----------

# ---- group: Generating planes
python = GhPythonScript(pnt=dividecurve.b)  # -> out, sfr; inputs pnt: list
# ---------- python: Python ----------
__author__ = "ILarikova"
__version__ = "2023.01.30"

import rhinoscriptsyntax as rs
import rhinoscriptsyntax as rs
import rhinoscriptsyntax as rs
from compas.geometry import Frame, Translation, Rotation
from compas.artists import Artist
import rhinoscriptsyntax as rs
import math

points = rs.coerce3dpointlist(pnt)

frames = []
for i in points:
    frame = Frame(i, (1,0,0), (0,1,0))
    frames.append(Artist(frame).draw())
sfr = frames
# ---------- end python ----------
pln = Plane(python.sfr)

# ---- group: Path
depth = Slider(2, range=0..10)
length = Slider(3, range=0..10)
x = Slider(6, range=0..10)
y = Slider(3, range=0..10)
python_2 = GhPythonScript(plane=python.sfr, steps=Slider(7, range=0..100), r=depth, l=graft(length), angle_x=x, angle_y=y)  # -> out, planes; inputs steps: Int32, r: Int32
# ---------- python_2: Python ----------
from compas.geometry import Frame, Translation, Rotation
from compas.artists import Artist
import rhinoscriptsyntax as rs
import math
import random

planes = []


for i in range(steps):
    frame = Frame(plane.Origin, plane.XAxis, -plane.YAxis)
    
    #r = 2
    
    
    #T = Translation.from_euler_angles(65.0,89.0,0.0)
    T = Translation.from_vector(-frame.zaxis*(math.cos(i)*r-r))
    #T1 = Translation.from_vector(frame.xaxis*(math.sin(i)))
    T1 = Translation.from_vector(frame.yaxis*(i*l))

    #R1 = Rotation.from_axis_and_angle(frame.zaxis, math.radians(angle_x*i), frame.point)
    

    frame.transform(T*T1)
    planes.append(Artist(frame).draw())

 
 
#frame.transform(T*T1*R1*R2)
# ---------- end python_2 ----------
