# Grasshopper definition sgraffito_paths_planner_impressionism.gh (Grasshopper 1.0.7)

# ---- group: input points
pt = Point([Point(-13.09077065, 7.133313688, 0), Point(-3.677236423, -5.566289148, 0), Point(-4.128688922, 7.708070113, 0), Point(8.366126745, 3.04701978, 0), Point(6.503578612, -10.73080479, 0), Point(2.297227838, 20.02265951, 0)])

# ---- group: frames from points
python = GhPythonScript(pnt=pt)  # -> out, sfr; inputs pnt: list
# ---------- python: Python ----------
__author__ = "ILarikova"
__version__ = "2023.01.30"

import rhinoscriptsyntax as rs
import rhinoscriptsyntax as rs
import rhinoscriptsyntax as rs
from compas.geometry import Frame, Translation, Rotation
from compas.artists import Artist
import rhinoscriptsyntax as rs
import math

points = rs.coerce3dpointlist(pnt)

frames = []
for i in points:
    frame = Frame(i, (1,0,0), (0,1,0))
    frames.append(Artist(frame).draw())
sfr = frames
# ---------- end python ----------
pln = Plane(python.sfr)

# ---- group: path
radius = Slider(3, range=0..10)
x = Slider(4, range=0..10)
pln_2 = Plane(python.sfr)
python_2 = GhPythonScript(plane=pln_2, steps=Slider(4, range=0..100), r=radius, angle_x=x)  # -> out, planes; inputs steps: Int32, r: Int32
# ---------- python_2: Python ----------
from compas.geometry import Frame, Translation, Rotation
from compas.artists import Artist
import rhinoscriptsyntax as rs
import math
import random

planes = []


for i in range(int(random.uniform(steps, steps+4))):
    frame = Frame(plane.Origin, plane.XAxis, -plane.YAxis)
    a = random.uniform(r,r+1)
    #r = 2
    
    
    #T = Translation.from_euler_angles(65.0,89.0,0.0)
    T = Translation.from_vector(frame.yaxis*(math.cos(i)*r-r))
    T1 = Translation.from_vector(frame.xaxis*(i**2))

    R1 = Rotation.from_axis_and_angle(frame.zaxis, math.radians(angle_x*i), frame.point)

    frame.transform(T*T1*R1)
    planes.append(Artist(frame).draw())

 
 
#frame.transform(T*T1*R1*R2)
# ---------- end python_2 ----------
